# Grasshopper definition Ramen+.gh (Grasshopper 1.0.8)
# plug-ins: Bifocals, FEMur

number_slider = Slider(1000, range=0..1000)
number_slider_2 = Slider(1000, range=0..1000)
unit_z = UnitZ(Factor=number_slider)
point = Point(Point(0, 0, 0))
unit_y = UnitY(Factor=number_slider_2)
move = Move(Geometry=point, Motion=unit_z)  # -> Geometry, Transform
unit_x = UnitX(Factor=number_slider_2)
move_2 = Move(Geometry=[point, move.Geometry], Motion=unit_x)  # -> Geometry, Transform
construct_domain = ConstructDomain(DomainStart=Slider(1, range=0..1), DomainEnd=Slider(2, range=0..10))
move_3 = Move(Geometry=move.Geometry, Motion=unit_y)  # -> Geometry, Transform
split_list = SplitList(List=move_2.Geometry, Index=Slider(1, range=0..1))  # -> ListA, ListB
merge = Merge(Data1=move.Geometry, Data2=move_3.Geometry)
number_slider_3 = Slider(0.0001, range=0..0.0001)
merge_2 = Merge(Data1=point, Data2=move.Geometry, Data3=split_list.ListB, Data4=split_list.ListA)  # -> flatten(Result)
move_4 = Move(Geometry=merge_2, Motion=unit_y)  # -> Geometry, Transform
line = Line(StartPoint=merge_2, EndPoint=move_4.Geometry)
polyline = PolyLine(Vertices=move_4.Geometry, Closed=False)
sub_list = SubList(List=line, Domain=construct_domain, Wrap=True)  # -> List, Index
polyline_2 = PolyLine(Vertices=merge_2, Closed=False)
number_slider_4 = Slider(1, range=0..10)
linear_array = LinearArray(Geometry=merge, Direction=unit_z, Count=number_slider_4)  # -> flatten(Geometry), Transform
merge_3 = Merge(Data1=polyline_2, Data2=polyline, Data3=sub_list.List)  # -> flatten(Result)
linear_array_2 = LinearArray(Geometry=merge_3, Direction=unit_z, Count=number_slider_4)  # -> flatten(Geometry), Transform
number_slider_5 = Slider(12, range=0..100)
number_slider_6 = Slider(100, range=0..200)
number_slider_7 = Slider(100, range=0..1000)
number_slider_8 = Slider(6, range=0..10)
number_slider_9 = Slider(8, range=0..10)
crosssection_h_femur = CrossSectionHFEMur(
    Id=0,
    Name="H-Section",
    B=number_slider_7,
    H=number_slider_6,
    T_f=number_slider_9,
    T_w=number_slider_5,
    R=number_slider_8)
crosssection_h_femur_2 = CrossSectionHFEMur(
    Id=0,
    Name="H-Section",
    B=number_slider_7,
    H=number_slider_6,
    T_f=number_slider_5,
    T_w=number_slider_9,
    R=number_slider_8)
material_femur = MaterialFEMur(Id=0)
unit_x_2 = UnitX(Factor=Slider(100, range=0..10000))
boolean_toggle = BooleanToggle(True)
linetobeam = LineToBeam(Polylines=linear_array_2.Geometry, Material=material_femur, CrossSection=crosssection_h_femur_2, BetaAngle=0)  # -> flatten(BeamElements), flatten(Points)
deconstruct = Deconstruct(Point=flatten(linetobeam.Points))  # -> XComponent, YComponent, ZComponent
deconstruct_2 = Deconstruct(Point=linetobeam.Points)  # -> XComponent, YComponent, ZComponent
equality = Equality(FirstNumber=deconstruct.ZComponent, SecondNumber=number_slider)  # -> Equality, Inequality
smaller_than = SmallerThan(FirstNumber=deconstruct_2.ZComponent, SecondNumber=Slider(0.0001, range=0..0.0001))  # -> SmallerThan, OrEqualTo
cull_pattern = CullPattern(List=flatten(linetobeam.Points), CullPattern=equality.Equality)  # -> flatten(List)
cull_pattern_2 = CullPattern(List=linetobeam.Points, CullPattern=smaller_than.SmallerThan)
cull_duplicates = CullDuplicates(Points=cull_pattern, Tolerance=0.1, CullMode=3)  # -> Points, Indices, Valence
deconstruct_3 = Deconstruct(Point=linetobeam.Points)  # -> XComponent, YComponent, ZComponent
pointload_femur = PointLoadFEMur(Points=cull_duplicates.Points, Force=unit_x_2, Moment=Vector(0, 0, 0))
support_femur = SupportFEMur(Points=cull_pattern_2, RX=False, RY=False, RZ=False, UX=True, UY=True, UZ=True)
panel = Panel(support_femur)
assemblemodel_femur = AssembleModelFEMur(
    Elements=linetobeam.BeamElements,
    Supports=support_femur,
    Loads=pointload_femur,
    IsDisplayTabExpanded=False,
    LocalAxisScale=0.3,
    ShowCrossSection=True,
    ShowElementId=False,
    ShowLoad=False,
    ShowLocalAxis=False,
    ShowNodeId=False,
    ShowSupport=True)
linearstaticsolver_femur = LinearStaticSolverFEMur(Model=assemblemodel_femur, Run=Toggle(True))  # -> AnalyzedModel, Info, Warnings
sectionforceview_femur = SectionForceViewFEMur(
    AnalyzedModel=linearstaticsolver_femur.AnalyzedModel,
    Scale=1,
    IsSectionForcesTabExpanded=False,
    SelectedForceType=5,
    ShowFilled=True,
    ShowNumbers=True)
