# Grasshopper definition Ramen.gh (Grasshopper 1.0.8)
# plug-ins: Pufferfish, Bifocals, FEMur

unit_z = UnitZ(Factor=Slider(1000, range=0..1000))
point = Point(Point(0, 0, 0))
move = Move(Geometry=point, Motion=unit_z)  # -> Geometry, Transform
unit_x = UnitX(Factor=Slider(1000, range=0..1000))
number_slider = Slider(1000, range=0..1000)
move_2 = Move(Geometry=[point, move.Geometry], Motion=unit_x)  # -> Geometry, Transform
number_slider_2 = Slider(4, range=0..10)
subtraction = Subtraction(A=number_slider_2, B=1)
split_list = SplitList(List=move_2.Geometry, Index=Slider(1, range=0..1))  # -> ListA, ListB
division = Division(A=number_slider, B=subtraction)
unit_x_2 = UnitX(Factor=division)
point_2 = Point(Point(0, 0, 0))
linear_array = LinearArray(Geometry=point_2, Direction=unit_x_2, Count=number_slider_2)  # -> Geometry, Transform
polyline = PolyLine(Vertices=linear_array.Geometry, Closed=False)
merge = Merge(Data1=point, Data2=move.Geometry, Data3=split_list.ListB, Data4=split_list.ListA)  # -> flatten(Result)
pi = Pi(Factor=Slider(2, range=0..2))
xy_plane = XYPlane(Origin=point)
rotate = Rotate(Geometry=merge, Angle=pi, Plane=xy_plane)  # -> Geometry, Transform
polyline_2 = PolyLine(Vertices=rotate.Geometry, Closed=False)
list_indices = ListIndices(List=rotate.Geometry)
list_item = ListItem(List=list_indices, Index="-1", Wrap=True)
panel = Panel("0.00014864096495526588")
number_slider_3 = Slider(1, range=0..10000)
expression = Expression(E=Slider(210000, range=0..1000000), I="10678762", P=number_slider_3, L=number_slider, Expression="P•L³/3/E/I")
panel_2 = Panel(expression)
node_femur = NodeFEMur(Points=rotate.Geometry)  # -> flatten(Nodes)
list_item_2 = ListItem(List=node_femur, Index="1", Wrap=True)
crosssection_h_femur = CrossSectionHFEMur(
    Id=0,
    Name="H-Section",
    B=Slider(100, range=0..1000),
    H=Slider(100, range=0..100),
    T_f=Slider(8, range=0..10),
    T_w=Slider(12, range=0..100),
    R=Slider(6, range=0..10))
unit_z_2 = UnitZ(Factor=number_slider_3)
unit_y = UnitY(Factor=number_slider_3)
material_femur = MaterialFEMur(Id=0)
linetobeam = LineToBeam(Polylines=polyline_2, Material=material_femur, CrossSection=crosssection_h_femur, BetaAngle=0)  # -> Beams, Points
linetobeam_2 = LineToBeam(Polylines=polyline_2, Material=material_femur, CrossSection=crosssection_h_femur, BetaAngle=0)  # -> Beams, Points
number_slider_4 = Slider(0, range=0..360)
split_list_2 = SplitList(List=node_femur, Index=list_item)  # -> ListA, ListB
split_list_3 = SplitList(List=node_femur, Index=Slider(1, range=0..1))  # -> ListA, ListB
boolean_toggle = BooleanToggle(False)
unit_x_3 = UnitX(Factor=number_slider_3)
boolean_toggle_2 = BooleanToggle(True)
panel_3 = Panel(linetobeam_2.Beams)
panel_4 = Panel(linetobeam.Beams)
panel_5 = Panel(material_femur)
panel_6 = Panel(crosssection_h_femur)
beamelement_femur = BeamElementFEMur(INodes=split_list_2.ListA, JNodes=split_list_3.ListB, Material=material_femur, CrossSection=crosssection_h_femur)
assemblemodel_femur = AssembleModelFEMur(Elements=linetobeam_2.Beams)
pointload_femur = PointLoadFEMur(Nodes=list_item_2, Force=unit_x_3, Moment=Vector(0, 0, 0))
support_femur = SupportFEMur(
    Nodes=[split_list_3.ListA, split_list_2.ListB],
    UX=boolean_toggle_2,
    UY=boolean_toggle_2,
    UZ=boolean_toggle_2,
    RX=boolean_toggle_2,
    RY=boolean_toggle_2,
    RZ=boolean_toggle_2)
merge_2 = Merge(Data2=pointload_femur)
panel_7 = Panel(beamelement_femur)
assemblemodel_femur_2 = AssembleModelFEMur(Nodes=node_femur, Elements=beamelement_femur, Supports=support_femur)
linearstaticsolver_femur = LinearStaticSolverFEMur(Model=assemblemodel_femur_2, Run=True)  # -> AnalyzedModel, Info, Warnings
resultview_femur = ResultViewFEMur(AnalyzedModel=linearstaticsolver_femur.AnalyzedModel, Scale=Slider(380, range=0..1000))  # -> DeformedModel, DeformedNodes
deconstructresult_femur = DeconstructResultFEMur(AnalyzedModel=linearstaticsolver_femur.AnalyzedModel)  # -> NodalDisplacements, ElementStresses, DisplacementValues, StressInfo
sectionforceview_femur = SectionForceViewFEMur(AnalyzedModel=linearstaticsolver_femur.AnalyzedModel, Scale=Slider(0.92, range=0..1))
panel_8 = Panel(deconstructresult_femur.ElementStresses)
showelementcoordinatesystem = ShowElementCoordinateSystem(Model=linearstaticsolver_femur.AnalyzedModel)
